# Grasshopper definition Phi Table.gh (Grasshopper 0.9.76)

num_points = Slider(258, range=0..1000)
cull_points = Slider(42, range=0..100)

# ----
# Assumptions
# 
# Angle Measured : Radians
# Distance : Imperial (Inches)
diameter = Slider(6, range=0..10)

phi_dot_radius = Slider(0.05, range=0..1)

# ---- group: Theta
pi = Pi(Factor=1)
multiplication = Multiplication(A=pi, B=2)

# ----
xy = XYPlane(Origin=Point(0, 0, 0))

# ---- group: PHI
phi = GoldenRatio(Factor=1)

# ----
subtraction = Subtraction(A=num_points, B=cull_points)

# ---- group: Radius
division = Division(A=diameter, B=2)

# ---- group: Series Count
series = Series(Start=cull_points, Step=1, Count=subtraction)

# ----
division_2 = Division(A=division, B=num_points)
multiplication_2 = Multiplication(A=phi, B=multiplication)
sqrt = SquareRoot(Value=series)
sqrt_2 = SquareRoot(Value=num_points)
multiplication_3 = Multiplication(A=sqrt, B=sqrt_2)
multiplication_4 = Multiplication(A=multiplication_2, B=series)
multiplication_5 = Multiplication(A=division_2, B=multiplication_3)
pt = ConstructPoint(XCoordinate=0, YCoordinate=multiplication_5, ZCoordinate=0)

# ---- group: PHI Points
rotate = Rotate(Geometry=pt, Angle=multiplication_4, Plane=xy)  # -> Geometry, Transform

# ----
circle = CircleCNR(Center=rotate.Geometry, Normal=Vector(0, 0, 1), Radius=phi_dot_radius)
